# Grasshopper definition faceshield_parametric.gh (Grasshopper 1.0.7)
# plug-ins: LunchBox

_2_holes = BooleanToggle(True)
additionnal_temple_width = Slider(0, range=0..500)
covered = BooleanToggle(True)
bake = Button()
hole_size_mm = Slider(4, range=0..10)
wall_thickness = Slider(2, range=0.1..5)
bottom_thickness = Slider(1, range=0.1..5)
height = Slider(12, range=0..20)
number_slider = Slider(302, range=0..360)
number_slider_2 = Slider(324, range=0..360)
mesh = Mesh(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)
mesh_2 = Mesh(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)
mesh_3 = Mesh(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)
mesh_4 = Mesh(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)
mesh_5 = Mesh(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)
bbox = BoundingBox(Content=mesh, Plane=PlaneXY(0, 0, 0))  # -> Box, Box_2
debrep = DeconstructBrep(Brep=bbox.Box)  # -> Faces, Edges, Vertices
X = UnitX(Factor=additionnal_temple_width)
pt = Point(Point(-71.33208643, -120.7499898, -0.4898159544))
pt_2 = Point(Point(81.67285742, -120.7499898, -0.4898159544))
area = Area(Geometry=debrep.Faces)  # -> Area, Centroid
move = Move(Geometry=pt, Motion=expr("X*-1", X))  # -> Geometry, Transform
move_2 = Move(Geometry=pt_2, Motion=X)  # -> Geometry, Transform
ln = Line(StartPoint=pt, EndPoint=pt_2)
Y = UnitY(Factor=5)
midpt = CurveMiddle(Curve=ln)
pdecon = Deconstruct(Point=area.Centroid)  # -> XComponent, YComponent, ZComponent
pt_3 = Point(move.Geometry)
pt_4 = Point(move_2.Geometry)
move_3 = Move(Geometry=ln, Motion=Y)  # -> Geometry, Transform
ln_2 = Line(StartPoint=pt_3, EndPoint=pt_4)
Z = UnitZ(Factor=expr("x*0.5", height))
scale = Scale(Geometry=move_3.Geometry, Center=midpt, Factor=2)  # -> Geometry, Transform
dist = Distance(PointA=pt_3, PointB=pt_4)
midpt_2 = CurveMiddle(Curve=ln_2)
X_2 = UnitX(Factor=expr("x*-1", additionnal_temple_width))
sort = SortList(Keys=pdecon.ZComponent, ValuesA=area.Centroid)  # -> Keys, ValuesA
sort_2 = SortList(Keys=pdecon.XComponent, ValuesA=debrep.Faces)  # -> Keys, ValuesA
sort_3 = SortList(Keys=pdecon.XComponent, ValuesA=area.Centroid)  # -> Keys, ValuesA
move_4 = Move(Geometry=scale.Geometry, Motion=Z)  # -> Geometry, Transform
dist_2 = Distance(PointA=pt_4, PointB=midpt_2)
item = ListItem(List=sort_2.ValuesA, Index=0, Wrap=True)
item_2 = ListItem(List=sort_3.ValuesA, Index=0, Wrap=True)
item_3 = ListItem(List=sort.ValuesA, Index=0, Wrap=True)
Y_2 = UnitY(Factor=dist_2)
pipe = Pipe(Curve=move_4.Geometry, Radius=expr("x*0.5", hole_size_mm), Caps=1)
number_slider_3 = Slider(40, range=0..100)
move_5 = Move(Geometry=item, Motion=X_2)  # -> Geometry, Transform
move_6 = Move(Geometry=item_2, Motion=X_2)  # -> Geometry, Transform
move_7 = Move(Geometry=midpt_2, Motion=Y_2)  # -> Geometry, Transform
yz = YZPlane(Origin=move_6.Geometry)
debrep_2 = DeconstructBrep(Brep=move_5.Geometry)  # -> Faces, Edges, Vertices
arc = Arc3Pt(PointA=pt_3, PointB=move_7.Geometry, PointC=pt_4)  # -> Arc, Plane, Radius
Y_3 = UnitY(Factor=Slider(20, range=-100..100))
Y_4 = UnitY(Factor=expr("(x/2)+10", hole_size_mm))
gate = StreamGate(Stream=pipe, Gate=_2_holes)  # -> Target0, Target1
item_4 = ListItem(List=debrep_2.Edges, Index=0, Wrap=True)
move_8 = Move(Geometry=arc.Arc, Motion=Y_3)  # -> Geometry, Transform
len = Length(Curve=item_4)
move_9 = Move(Geometry=gate.Target1, Motion=Y_4)  # -> Geometry, Transform
X_3 = UnitX(Factor=expr("x*-1", wall_thickness))
X_4 = UnitX(Factor=expr("x*-1", wall_thickness))
end = EndPoints(Curve=move_8.Geometry)  # -> Start, End
X_5 = UnitX(Factor=wall_thickness)
midpt_3 = CurveMiddle(Curve=move_8.Geometry)
X_6 = UnitX(Factor=wall_thickness)
Y_5 = UnitY(Factor=number_slider_3)
division = Division(A=additionnal_temple_width, B="10.003601")
polygon = Polygon(Plane=yz, Radius=expr("x*0.5", len), Segments=8, FilletRadius=0)  # -> Polygon, Length
addition = Addition(A="10.003601", B=division)
X_7 = UnitX(Factor=addition)
move_10 = Move(Geometry=end.End, Motion=X_6)  # -> Geometry, Transform
move_11 = Move(Geometry=pt_4, Motion=X_6)  # -> Geometry, Transform
move_12 = Move(Geometry=midpt_3, Motion=Y_5)  # -> Geometry, Transform
move_13 = Move(Geometry=end.Start, Motion=X_4)  # -> Geometry, Transform
move_14 = Move(Geometry=pt_3, Motion=X_4)  # -> Geometry, Transform
move_15 = Move(Geometry=end.End, Motion=X_5)  # -> Geometry, Transform
move_16 = Move(Geometry=end.Start, Motion=X_3)  # -> Geometry, Transform
ln_3 = Line(StartPoint=end.Start, EndPoint=end.End)
pt_5 = Point(move_8.Geometry)
ln_4 = Line(StartPoint=pt_3, EndPoint=move_14.Geometry)
ln_5 = Line(StartPoint=pt_4, EndPoint=move_11.Geometry)
rotate = Rotate(Geometry=polygon.Polygon, Angle=degrees(22.5), Plane=yz)  # -> Geometry, Transform
pt_6 = Point(end.Start)
pt_7 = Point(end.End)
Y_6 = UnitY(Factor=number_slider_3)
midpt_4 = CurveMiddle(Curve=ln_3)
arc_2 = Arc3Pt(PointA=move_15.Geometry, PointB=move_12.Geometry, PointC=move_16.Geometry)  # -> Arc, Plane, Radius
ln_6 = Line(StartPoint=pt_4, EndPoint=pt_7)
ln_7 = Line(StartPoint=pt_3, EndPoint=pt_6)
X_8 = UnitX(Factor=expr("x*-0.25", len))
move_17 = Move(Geometry=move_8.Geometry, Motion=Y_6)  # -> Geometry, Transform
offset = OffsetCurve(Curve=rotate.Geometry, Distance=expr("x*0.25", len), Plane=PlaneXY(0, 0, 0), Corners=1)
ln_8 = Line(StartPoint=midpt_4, EndPoint=move_12.Geometry)
move_18 = Move(Geometry=offset, Motion=X_8)  # -> Geometry, Transform
rotate_2 = Rotate(Geometry=ln_8, Angle=expr("x*-1", degrees(number_slider)), Plane=midpt_4)  # -> Geometry, Transform
rotate_3 = Rotate(Geometry=ln_8, Angle=expr("x*-1", degrees(number_slider_2)), Plane=midpt_4)  # -> Geometry, Transform
loft = Loft(
    Curves=flatten([rotate.Geometry, move_18.Geometry]),
    Options={Adjust=False, Closed=False, LoftEnds=0, LoftSimp=0, LoftType=0, Rebuild=10, Refit=0.01})
rotate_4 = Rotate(Geometry=ln_8, Angle=degrees(number_slider), Plane=midpt_4)  # -> Geometry, Transform
rotate_5 = Rotate(Geometry=ln_8, Angle=degrees(number_slider_2), Plane=midpt_4)  # -> Geometry, Transform
extr = Extrude(Base=rotate.Geometry, Direction=X_7)
join = BrepJoin(Breps=flatten([loft, extr]))  # -> Breps, Closed
clx = CurveLine(Curve=move_17.Geometry, Line=[rotate_4.Geometry, rotate_2.Geometry])  # -> Points, Params, Count
clx_2 = CurveLine(Curve=arc_2.Arc, Line=[rotate_4.Geometry, rotate_2.Geometry])  # -> Points, Params, Count
clx_3 = CurveLine(Curve=move_17.Geometry, Line=rotate_5.Geometry)  # -> Points, Params, Count
clx_4 = CurveLine(Curve=move_17.Geometry, Line=rotate_3.Geometry)  # -> Points, Params, Count
cap = CapHoles(Brep=join.Breps)
item_5 = ListItem(List=flatten(clx.Points), Index=0, Wrap=True)  # -> Item, Item1
item_6 = ListItem(List=flatten(clx_2.Points), Index=0, Wrap=True)  # -> Item, Item1
bbox_2 = BoundingBox(Content=cap, Plane=PlaneXY(0, 0, 0))  # -> Box, Box_2
pline = PolyLine(Vertices=flatten([item_5.Item, clx_4.Points, clx_3.Points, item_5.Item1]), Closed=True)
arc_3 = Arc3Pt(PointA=clx_3.Points, PointB=move_12.Geometry, PointC=clx_4.Points)  # -> Arc, Plane, Radius
arc_4 = Arc3Pt(PointA=item_5.Item, PointB=move_12.Geometry, PointC=item_5.Item1)  # -> Arc, Plane, Radius
arc_5 = Arc3Pt(PointA=item_6.Item, PointB=move_12.Geometry, PointC=item_6.Item1)  # -> Arc, Plane, Radius
clx_5 = CurveLine(Curve=arc_5.Arc, Line=rotate_5.Geometry)  # -> Points, Params, Count
clx_6 = CurveLine(Curve=arc_5.Arc, Line=rotate_3.Geometry)  # -> Points, Params, Count
ln_9 = Line(StartPoint=clx_3.Points, EndPoint=clx_5.Points)
ln_10 = Line(StartPoint=clx_4.Points, EndPoint=clx_6.Points)
pline_2 = PolyLine(Vertices=flatten([move_8.Geometry, clx_5.Points, clx_6.Points]), Closed=True)
debrep_3 = DeconstructBrep(Brep=bbox_2.Box)  # -> Faces, Edges, Vertices
midpt_5 = CurveMiddle(Curve=ln_10)
midpt_6 = CurveMiddle(Curve=ln_9)
trim = TrimWithRegion(Curve=arc_5.Arc, Region=pline_2)  # -> Inside, Outside
trim_2 = TrimWithRegion(Curve=move_17.Geometry, Region=pline)  # -> Inside, Outside
offset_2 = OffsetCurve(Curve=arc_5.Arc, Distance=wall_thickness, Plane=PlaneXY(0, 0, 0), Corners=1)
pt_8 = Point([move_14.Geometry, move_13.Geometry, item_5.Item1])
area_2 = Area(Geometry=debrep_3.Faces)  # -> Area, Centroid
ln_11 = Line(StartPoint=move_12.Geometry, EndPoint=midpt_5)
ln_12 = Line(StartPoint=move_12.Geometry, EndPoint=midpt_6)
crv = Curve(arc_4.Arc)
crv_2 = Curve(move_8.Geometry)
pt_9 = Point([item_5.Item, move_10.Geometry, move_11.Geometry])
len_2 = Length(Curve=trim.Outside)
len_3 = Length(Curve=trim_2.Outside)
end_2 = EndPoints(Curve=offset_2)  # -> Start, End
flip = FlipCurve(Curve=ln_11)  # -> Curve, Flag
flip_2 = FlipCurve(Curve=ln_12)  # -> Curve, Flag
pdecon_2 = Deconstruct(Point=pt_8)  # -> XComponent, YComponent, ZComponent
pdecon_3 = Deconstruct(Point=pt_9)  # -> XComponent, YComponent, ZComponent
pdecon_4 = Deconstruct(Point=area_2.Centroid)  # -> XComponent, YComponent, ZComponent
sort_4 = SortList(Keys=len_2, ValuesA=trim.Outside)  # -> Keys, ValuesA
sort_5 = SortList(Keys=len_3, ValuesA=trim_2.Outside)  # -> Keys, reverse(ValuesA)
number_slider_4 = Slider(50, range=0..50)
sort_6 = SortList(Keys=pdecon_2.YComponent, ValuesA=pt_8)  # -> Keys, ValuesA
sort_7 = SortList(Keys=pdecon_3.YComponent, ValuesA=pt_9)  # -> Keys, ValuesA
ln_13 = Line(StartPoint=end_2.Start, EndPoint=end_2.End)
ln_14 = Line(StartPoint=item_6.Item, EndPoint=end_2.Start)
ln_15 = Line(StartPoint=end_2.End, EndPoint=item_6.Item1)
sort_8 = SortList(Keys=pdecon_4.ZComponent, ValuesA=area_2.Centroid)  # -> Keys, ValuesA
shift = ShiftList(List=sort_5.ValuesA, Shift=1, Wrap=True)
intcrv = Interpolate(Vertices=sort_6.ValuesA, Degree=3, Periodic=False, KnotStyle=1)  # -> Curve, Length, Domain
intcrv_2 = Interpolate(Vertices=sort_7.ValuesA, Degree=3, Periodic=False, KnotStyle=1)  # -> Curve, Length, Domain
arc_6 = ArcSED(Start=clx_4.Points, End=clx_6.Points, Direction=flip.Curve)  # -> Arc, Plane, Radius
arc_7 = ArcSED(Start=clx_3.Points, End=clx_5.Points, Direction=flip_2.Curve)  # -> Arc, Plane, Radius
item_7 = ListItem(List=sort_8.ValuesA, Index=0, Wrap=True)
item_8 = ListItem(List=sort_4.ValuesA, Index=0, Wrap=True)  # -> Item, Item1
item_9 = ListItem(List=shift, Index=0, Wrap=True)  # -> Item, Item1
vec2pt = Vector2Pt(PointA=item_7, PointB=item_3, Unitize=False)  # -> Vector, Length
join_2 = JoinCurves(Curves=flatten([arc_6.Arc, item_9.Item]), Preserve=False)
join_3 = JoinCurves(Curves=flatten([arc_7.Arc, item_9.Item1]), Preserve=False)  # -> flatten(Curves)
midpt_7 = CurveMiddle(Curve=offset_2)
move_19 = Move(Geometry=cap, Motion=vec2pt.Vector)  # -> Geometry, Transform
fillet = Fillet(Curve=join_2, Radius=number_slider_4)
fillet_2 = Fillet(Curve=join_3, Radius=number_slider_4)
merge = Merge(
    Data1=ln_14,
    Data2=offset_2,
    Data3=crv_2,
    Data4=intcrv.Curve,
    Data5=intcrv_2.Curve,
    Data6=fillet_2,
    Data7=fillet,
    Data8=ln_7,
    Data9=ln_6,
    Data10=ln_4,
    Data11=ln_5,
    Data12=item_8.Item,
    Data13=item_8.Item1,
    Data16=ln_15)
pt_10 = Point(midpt_7)
division_2 = Division(A="54.059661", B=2)
pdecon_5 = Deconstruct(Point=midpt)  # -> XComponent, YComponent, ZComponent
join_4 = JoinCurves(Curves=flatten(merge), Preserve=False)
addition_2 = Addition(A="75.36341", B=division_2)
crv_cp = CurveClosestPoint(Point=pt_10, Curve=offset_2)  # -> Point, Parameter, Distance
crv_cp_2 = CurveClosestPoint(Point=pt_10, Curve=offset_2)  # -> Point, Parameter, Distance
offset_3 = OffsetCurve(Curve=join_4, Distance=expr("X*-1", wall_thickness), Plane=PlaneXY(0, 0, 0), Corners=2)
lenp = LengthParameter(Curve=offset_2, Parameter=crv_cp.Parameter)  # -> Length, Length_2
lenp_2 = LengthParameter(Curve=offset_2, Parameter=crv_cp_2.Parameter)  # -> Length, Length_2
yz_2 = YZPlane(Origin=midpt_7)
fillet_3 = Fillet(Curve=offset_3, Radius=Slider(2, range=0..5))
Z_2 = UnitZ(Factor=height)
Z_3 = UnitZ(Factor=bottom_thickness)
addition_3 = Addition(A=lenp.Length, B=division_2)
addition_4 = Addition(A=lenp_2.Length, B=addition_2)
boundary = BoundarySurfaces(Edges=flatten([join_4, fillet_3]))  # -> flatten(Surfaces)
boundary_2 = BoundarySurfaces(Edges=fillet_3)
eval = EvaluateLength(Curve=offset_2, Length=addition_3, Normalized=False)  # -> Point, Tangent, Parameter
pdecon_6 = Deconstruct(Point=eval.Point)  # -> XComponent, YComponent, ZComponent
eval_2 = EvaluateLength(Curve=offset_2, Length=addition_4, Normalized=False)  # -> Point, Tangent, Parameter
vec2pt_2 = Vector2Pt(PointA=item_3, PointB=eval_2.Point, Unitize=False)  # -> Vector, Length
move_20 = Move(Geometry=move_19.Geometry, Motion=vec2pt_2.Vector)  # -> Geometry, Transform
bbox_3 = BoundingBox(Content=move_20.Geometry, Plane=PlaneXY(0, 0, 0))  # -> Box, Box_2
area_3 = Area(Geometry=bbox_3.Box)  # -> Area, Centroid
pdecon_7 = Deconstruct(Point=area_3.Centroid)  # -> XComponent, YComponent, ZComponent
pt_11 = ConstructPoint(XCoordinate=pdecon_5.XComponent, YCoordinate=pdecon_5.YComponent, ZCoordinate=pdecon_7.ZComponent)
vec2pt_3 = Vector2Pt(PointA=area_3.Centroid, PointB=pt_11, Unitize=False)  # -> Vector, Length
panel = Panel(area_3.Centroid)
move_21 = Move(Geometry=move_20.Geometry, Motion=vec2pt_3.Vector)  # -> Geometry, Transform
yz_3 = YZPlane(Origin=pt_11)
pt_12 = ConstructPoint(XCoordinate=pdecon_6.XComponent, YCoordinate=pdecon_6.YComponent, ZCoordinate=pdecon_7.ZComponent)
extr_2 = Extrude(Base=boundary, Direction=Z_2)
extr_3 = Extrude(Base=boundary_2, Direction=Z_3)
rotate_6 = Rotate(Geometry=move_21.Geometry, Angle=degrees(270), Plane=pt_11)  # -> Geometry, Transform
mirror = Mirror(Geometry=eval.Point, Plane=yz_2)  # -> Geometry, Transform
pdecon_8 = Deconstruct(Point=mirror.Geometry)  # -> XComponent, YComponent, ZComponent
pt_13 = ConstructPoint(XCoordinate=pdecon_8.XComponent, YCoordinate=pdecon_8.YComponent, ZCoordinate=pdecon_7.ZComponent)
mirror_2 = Mirror(Geometry=eval_2.Point, Plane=yz_2)  # -> Geometry, Transform
sdiff = SolidDifference(BrepsA=extr_2, BrepsB=[pipe, move_9.Geometry])
vec2pt_4 = Vector2Pt(PointA=pt_11, PointB=[pt_12, pt_13], Unitize=False)  # -> Vector, Length
mirror_3 = Mirror(Geometry=move_20.Geometry, Plane=yz_3)  # -> Geometry, Transform
gate_2 = StreamGate(Stream=extr_3, Gate=covered)  # -> Target0, Target1
move_22 = Move(Geometry=rotate_6.Geometry, Motion=vec2pt_4.Vector)  # -> Geometry, Transform
item_10 = ListItem(List=move_22.Geometry, Index=0, Wrap=True)  # -> Item, Item1
Z_4 = UnitZ(Factor=expr("x*-1.1", height))
join_5 = JoinCurves(Curves=[offset_2, ln_13], Preserve=False)
brep = Brep(mirror_3.Geometry)
brep_2 = Brep(move_20.Geometry)
brep_3 = Brep(item_10.Item)
brep_4 = Brep(item_10.Item1)
Z_5 = UnitZ(Factor=expr("x*2.2", height))
move_23 = Move(Geometry=join_5, Motion=Z_4)  # -> Geometry, Transform
extr_4 = Extrude(Base=move_23.Geometry, Direction=Z_5)
cap_2 = CapHoles(Brep=extr_4)
sdiff_2 = SolidDifference(BrepsA=[brep, brep_2, brep_3, brep_4], BrepsB=cap_2)
sunion = SolidUnion(Breps=flatten([gate_2.Target1, sdiff_2, sdiff]))
preview = CustomPreview(
    Geometry=sunion,
    Material={diffuse=RGB(221, 160, 221), emission=RGB(66, 48, 66), shine=0.5, specular=RGB(255, 255, 255), transparency=0})
bake_2 = ObjectBake(
    BakeToggle=bake,
    GeometryObjects=sunion,
    Layer="GH_Bake",
    ObjectName="GH_Obj",
    ObjectColor=RGB(255, 255, 255),
    LayerColor=RGB(255, 255, 255))
